# Dynamo graph Parameter.dyn (Dynamo 1.3.4.6666)

# group: Add project parameter
code_block = CodeBlock()
# ---------- code_block.designscript (14 lines) ----------
//Parameter name
{"test1","test2"};
//Parameter type
"Text";
//Parameter group
"PG_IDENTITY_DATA";
//Tooltip
"Some tooltip";
//Instances
true;
//Vary Between Groups
true;
//Category
{"Walls","Windows"};
# ----------------------------------------
byName = Category.ByName(code_block.out6)
addProjectParameter = Orchid.RevitProject.Parameters.Parameter.AddProjectParameter(code_block.out0, code_block.out1, code_block.out2, code_block.out3, code_block.out4, code_block.out5, byName)

# group: Add shared parameter
code_block_2 = CodeBlock()
# ---------- code_block_2.designscript (17 lines) ----------
//Parameter name
{"Creator Name",
"Creator Organization",
"Creator Build"};
//{"Paper Size","Subject"};
//SP Parameter group
"Sheet & Project";
//SP Parameter type
"Text";
//Parameter group
"PG_ADSK_MODEL_PROPERTIES";
//Instances
true;
//Vary Between Groups
true;
//Category
"Doors";
# ----------------------------------------
byName_2 = Category.ByName(code_block_2.out6)
addSharedParameter = Orchid.RevitProject.Parameters.Parameter.AddSharedParameter(code_block_2.out0, code_block_2.out1, code_block_2.out2, code_block_2.out3, arg6=byName_2)

# group: Change parameter and category binding in the project
code_block_3 = CodeBlock()
# ---------- code_block_3.designscript (8 lines) ----------
//Parameter name
"Creator Name";
//Instances
true;
//Category
{"Doors",
"Entourage",
"Floors"};
# ----------------------------------------
byName_3 = Category.ByName(code_block_3.out2)
changeCategory = Orchid.RevitProject.Parameters.Parameter.ChangeCategory(code_block_3.out0, arg2=byName_3)  # frozen

# group: Delete parameter
code_block_4 = CodeBlock()
# ---------- code_block_4.designscript (2 lines) ----------
{"Creator Build",
"test2"};
# ----------------------------------------
delete = Orchid.RevitProject.Parameters.Parameter.Delete(code_block_4)  # frozen

# group: Project parameters in document
projectParameters = Orchid.RevitProject.Parameters.Parameter.ProjectParameters()
watch = Watch(projectParameters)
name = Element.Name(projectParameters)
watch_2 = Watch(name)

# group: Global parameters in document
globalParameters = Orchid.RevitProject.Parameters.Parameter.GlobalParameters()
watch_3 = Watch(globalParameters)
name_2 = Element.Name(globalParameters)
watch_4 = Watch(name_2)

# group: Shared parameters in document
sharedParameters = Orchid.RevitProject.Parameters.Parameter.SharedParameters()
name_3 = Element.Name(sharedParameters.out0)
watch_5 = Watch(name_3)
watch_6 = Watch(sharedParameters.out0)
watch_7 = Watch(sharedParameters.out1)

# group: clean for unwanted parameters
string = StringInput("ParameterCopy")
contains = String.Contains(str=name_3, searchFor=string)
filterByBoolMask = List.FilterByBoolMask(list=sharedParameters.out0, mask=contains)
delete_2 = Orchid.RevitProject.Elements.Element.Delete(filterByBoolMask.in)  # frozen
name_4 = Element.Name(filterByBoolMask.in)
watch_8 = Watch(name_4)
watch_9 = Watch(filterByBoolMask.in)

# group: Add basic IFC parameter
addIfcParameters = Orchid.RevitProject.Parameters.Parameter.AddIfcParameters()  # frozen

# group: Associate --> global parameters
categories = Categories("Windows")
all_elements_of_category = ElementsOfCategory(categories)
code_block_5 = CodeBlock { "test2"; }
associate = Orchid.RevitProject.Parameters.Parameter.Associate(all_elements_of_category, code_block_5, globalParameters, lacing=Longest)
await_ = Orchid.Core.DataStream.Await(all_elements_of_category, associate)
getAssociated = Orchid.RevitProject.Parameters.Parameter.GetAssociated(await_, code_block_5)
watch_10 = Watch(getAssociated)
hasAssociated = Orchid.RevitProject.Parameters.Parameter.HasAssociated(await_, code_block_5)
watch_11 = Watch(hasAssociated)

# group: Create shared parameter
code_block_6 = CodeBlock()
# ---------- code_block_6.designscript (16 lines) ----------
//Parameter name
"Dynamo test parameter";
//SP Parameter group
"Dynamo test group";
//SP Parameter type
"Text";
//Parameter group
"PG_ADSK_MODEL_PROPERTIES";
//Tooltip
"Some tooltip";
//Instances
true;
//Vary Between Groups
true;
//Category
"Doors";
# ----------------------------------------
byName_4 = Category.ByName(code_block_6.out7)
createSharedParameter = Orchid.RevitProject.Parameters.Parameter.CreateSharedParameter(code_block_6.out0, code_block_6.out1, code_block_6.out2, code_block_6.out3, arg7=byName_4)  # frozen
addSharedParameter_2 = Orchid.RevitProject.Parameters.Parameter.AddSharedParameter(code_block_6.out0, code_block_6.out1, code_block_6.out2, code_block_6.out3, code_block_6.out5, code_block_6.out6, byName_4)  # frozen
