# Dynamo graph Material.dyn (Dynamo 1.3.4.6666)

# group: All
all = Orchid.Revit.Materials.Material.All()
name = Material.Name(all)
watch = Watch(name)
watch_2 = Watch(all)

# group: Class/Category
material = MaterialDD("Brick, Common")
getCategory = Orchid.Revit.Materials.Material.GetCategory(material)
watch_3 = Watch(getCategory)
getClass = Orchid.Revit.Materials.Material.GetClass(material)
watch_4 = Watch(getClass)

# group: Asset
material_2 = MaterialDD("Brick, Common")
asset = Orchid.Revit.Materials.Material.Asset(material_2)
watch_5 = Watch(asset.out0)
watch_6 = Watch(asset.out1)
watch_7 = Watch(asset.out2)

# group: Asset Parameter
material_3 = MaterialDD("Brick, Common")
assetParameter = Orchid.Revit.Materials.Material.AssetParameter(material_3)
watch_8 = Watch(assetParameter.out0)
watch_9 = Watch(assetParameter.out1)
watch_10 = Watch(assetParameter.out2)

# group: Parameter
material_4 = MaterialDD("Brick, Common")
parameter = Orchid.Revit.Materials.Material.Parameter(material_4)
watch_11 = Watch(parameter)

# group: Asset
material_5 = MaterialDD("Brick, Common")
appearanceAsset = Orchid.Revit.Materials.Material.AppearanceAsset(material_5)
watch_12 = Watch(appearanceAsset)
physicalAsset = Orchid.Revit.Materials.Material.PhysicalAsset(material_5)
watch_13 = Watch(physicalAsset)
thermalAsset = Orchid.Revit.Materials.Material.ThermalAsset(material_5)
watch_14 = Watch(thermalAsset)
