# Dynamo graph File+Fam-LoadFamily.dyn (Dynamo 2.0.3.8810)

loadFamily = Orchid.Core.File.LoadFamily()  # frozen
watch = Watch(loadFamily)

# group: Open all files in directory and sub directories
string = StringInput(".\testSet")  # graph input
code_block = CodeBlock { "*.rfa"; }
boolean = BoolSelector(false)  # graph input
contents = Orchid.Core.Directory.Contents(directory=string, searchString=code_block, deepSearch=boolean)

loadFamily_2 = Orchid.Core.File.LoadFamily(family=contents)
watch_2 = Watch(loadFamily_2)

# group: Open all files in directory and sub directories
string_2 = StringInput(".\testSet")  # graph input
code_block_2 = CodeBlock { "*.rfa"; }
boolean_2 = BoolSelector(false)  # graph input
contents_2 = Orchid.Core.Directory.Contents(directory=string_2, searchString=code_block_2, deepSearch=boolean_2)
backgroundOpen = Orchid.RevitProject.Common.Document.BackgroundOpen(file=contents_2)  # frozen

loadFamily_3 = Orchid.RevitProject.Common.Document.LoadFamily(familyDocument=backgroundOpen)
watch_3 = Watch(loadFamily_3)

# group: Open all files in directory and sub directories
string_3 = StringInput(".\testSet")  # graph input
code_block_3 = CodeBlock { "*.rfa"; }
boolean_3 = BoolSelector(false)  # graph input
contents_3 = Orchid.Core.Directory.Contents(directory=string_3, searchString=code_block_3, deepSearch=boolean_3)

await_ = Orchid.Core.DataStream.Await(pass=backgroundOpen, waitFor=loadFamily_3)

# group: Close files
close = Orchid.RevitProject.Common.Document.Close(document=await_)
