# Dynamo graph Material.dyn "Material_20" (Dynamo 2.0.2.6826)

# group: All
all = Orchid.Revit.Materials.Material.All()
name = Material.Name(material=all)
watch = Watch(name)
watch_2 = Watch(all)

# group: Class/Category
material = MaterialDD(index=1)  # graph input
getCategory = Orchid.Revit.Materials.Material.GetCategory(material=material)
watch_3 = Watch(getCategory)
getClass = Orchid.Revit.Materials.Material.GetClass(material=material)
watch_4 = Watch(getClass)

# group: Asset
material_2 = MaterialDD(index=1)  # graph input
asset = Orchid.Revit.Materials.Material.Asset(material=material_2)
watch_5 = Watch(asset.Appearance)
watch_6 = Watch(asset.Physical)
watch_7 = Watch(asset.Thermal)

# group: Asset Parameter
material_3 = MaterialDD(index=1)  # graph input
assetParameter = Orchid.Revit.Materials.Material.AssetParameter(material=material_3)
watch_8 = Watch(assetParameter.Appearance)
watch_9 = Watch(assetParameter.Physical)
watch_10 = Watch(assetParameter.Thermal)

# group: Parameter
material_4 = MaterialDD(index=1)  # graph input
parameter = Orchid.Revit.Materials.Material.Parameter(material=material_4)
watch_11 = Watch(parameter)

# group: Asset
material_5 = MaterialDD(index=1)  # graph input
appearanceAsset = Orchid.Revit.Materials.Material.AppearanceAsset(material=material_5)
watch_12 = Watch(appearanceAsset)
physicalAsset = Orchid.Revit.Materials.Material.PhysicalAsset(material=material_5)
watch_13 = Watch(physicalAsset)
thermalAsset = Orchid.Revit.Materials.Material.ThermalAsset(material=material_5)
watch_14 = Watch(thermalAsset)
