# Dynamo graph Physical-Thermal.dyn (Dynamo 2.0.2.6826)

# group: Create material: Concrete (C30)
code_block = CodeBlock { "_Concrete"; }
create = Orchid.Revit.Materials.Material.Create(name=code_block)
material_aspect = MaterialAspectDD(index=1)  # graph input
thermal_type = ThermalTypeDD(index=2)  # graph input
boolean = BoolSelector(true)  # graph input
create_2 = Orchid.Revit.Materials.ThermalAsset.Create(name=code_block, type=thermal_type, uniqueName=boolean)
code_block_2 = CodeBlock { "Concrete f'c=30 MPa"; "structural,concrete,CC:BS 8110"; "thermal,solid"; "Orchid generated"; }
setInformation = Orchid.Revit.Materials.ThermalAsset.SetInformation(thermalAsset=create_2, description=code_block_2.out0, keywords=code_block_2.out2, source=code_block_2.out3)
boolean_2 = BoolSelector(false)  # graph input
asset_behavior = AssetBehaviorDD(index=0)  # graph input
code_block_3 = CodeBlock { 1.046; 0.657; 2300; 0.95; 182.4; 0.01; 0; 2000000; }
setProperties = Orchid.Revit.Materials.ThermalAsset.SetProperties(thermalAsset=setInformation, transmitsLight=boolean_2, behavior=asset_behavior, thermalConductivity=code_block_3.out0, specificHeat=code_block_3.out1, density=code_block_3.out2, emissivity=code_block_3.out3, permeability=code_block_3.out4, porosity=code_block_3.out5, reflectivity=code_block_3.out6, electricalResistivity=code_block_3.out7)
propertySet = Orchid.Revit.Materials.ThermalAsset.PropertySet(thermalAsset=setProperties)
setAsset = Orchid.Revit.Materials.Material.SetAsset(material=create, aspect=material_aspect, propertySet=propertySet)
name = Material.Name(material=setAsset)
watch = Watch(name)
watch_2 = Watch(setAsset)
material_aspect_2 = MaterialAspectDD(index=0)  # graph input
physical_type = PhysicalTypeDD(index=1)  # graph input
create_3 = Orchid.Revit.Materials.PhysicalAsset.Create(name=code_block, type=physical_type, uniqueName=boolean)
setInformation_2 = Orchid.Revit.Materials.PhysicalAsset.SetInformation(physicalAsset=create_3, description=code_block_2.out0, keywords=code_block_2.out1, source=code_block_2.out3)
asset_behavior_2 = AssetBehaviorDD(index=0)  # graph input
setBehavior = Orchid.Revit.Materials.PhysicalAsset.SetBehavior(physicalAsset=setInformation_2, behavior=asset_behavior_2)
code_block_4 = CodeBlock { 0.00001; }
setBasicThermal = Orchid.Revit.Materials.PhysicalAsset.SetBasicThermal(physicalAsset=setBehavior, expansionCoefficient=code_block_4)
code_block_5 = CodeBlock { 20500; 0.2; 11200; 2406.45; }
setMechanical = Orchid.Revit.Materials.PhysicalAsset.SetMechanical(physicalAsset=setBasicThermal, youngModulus=code_block_5.out0, poissonRatio=code_block_5.out1, shearModulus=code_block_5.out2, density=code_block_5.out3)
code_block_6 = CodeBlock { 30.0; 1.0; }
boolean_3 = BoolSelector(false)  # graph input
setConcrete = Orchid.Revit.Materials.PhysicalAsset.SetConcrete(physicalAsset=setMechanical, compression=code_block_6.out0, shearStrengthReduction=code_block_6.out1, lightweight=boolean_3)
propertySet_2 = Orchid.Revit.Materials.PhysicalAsset.PropertySet(physicalAsset=setConcrete)
setAsset_2 = Orchid.Revit.Materials.Material.SetAsset(material=create, aspect=material_aspect_2, propertySet=propertySet_2)
name_2 = Material.Name(material=setAsset_2)
watch_3 = Watch(name_2)
watch_4 = Watch(setAsset_2)

# group: Create material: Oxygen
code_block_7 = CodeBlock { "_Oxygen"; }
create_4 = Orchid.Revit.Materials.Material.Create(name=code_block_7)
material_aspect_3 = MaterialAspectDD(index=1)  # graph input
thermal_type_2 = ThermalTypeDD(index=0)  # graph input
boolean_4 = BoolSelector(true)  # graph input
create_5 = Orchid.Revit.Materials.ThermalAsset.Create(name=code_block_7, type=thermal_type_2, uniqueName=boolean_4)
code_block_8 = CodeBlock { "Oxygen, properties at atmospheric pressure"; "structural,gas"; "thermal,gas"; "Orchid generated"; }
setInformation_3 = Orchid.Revit.Materials.ThermalAsset.SetInformation(thermalAsset=create_5, description=code_block_8.out0, keywords=code_block_8.out2, source=code_block_8.out3)
code_block_9 = CodeBlock { 0.0242; 0.9118; 1.35; 0.01; 0; 1; }
setBasicThermal_2 = Orchid.Revit.Materials.ThermalAsset.SetBasicThermal(thermalAsset=setInformation_3, thermalConductivity=code_block_9.out0, specificHeat=code_block_9.out1, density=code_block_9.out2, emissivity=code_block_9.out3, gasViscosity=code_block_9.out4, compressibility=code_block_9.out5)
propertySet_3 = Orchid.Revit.Materials.ThermalAsset.PropertySet(thermalAsset=setBasicThermal_2)
setAsset_3 = Orchid.Revit.Materials.Material.SetAsset(material=create_4, aspect=material_aspect_3, propertySet=propertySet_3)
watch_5 = Watch(setAsset_3)
name_3 = Material.Name(material=setAsset_3)
watch_6 = Watch(name_3)
material_aspect_4 = MaterialAspectDD(index=1)  # graph input
physical_type_2 = PhysicalTypeDD(index=5)  # graph input
create_6 = Orchid.Revit.Materials.PhysicalAsset.Create(name=code_block_7, type=physical_type_2, uniqueName=boolean_4)
setInformation_4 = Orchid.Revit.Materials.PhysicalAsset.SetInformation(physicalAsset=create_6, description=code_block_8.out0, keywords=code_block_8.out1, source=code_block_8.out3)
code_block_10 = CodeBlock { 500; }
setBasicThermal_3 = Orchid.Revit.Materials.PhysicalAsset.SetBasicThermal(physicalAsset=setInformation_4, expansionCoefficient=code_block_10)
code_block_11 = CodeBlock { 1.35; }
setMechanical_2 = Orchid.Revit.Materials.PhysicalAsset.SetMechanical(physicalAsset=setBasicThermal_3, density=code_block_11)
propertySet_4 = Orchid.Revit.Materials.PhysicalAsset.PropertySet(physicalAsset=setMechanical_2)
setAsset_4 = Orchid.Revit.Materials.Material.SetAsset(material=create_4, aspect=material_aspect_4, propertySet=propertySet_4)
watch_7 = Watch(setAsset_4)
name_4 = Material.Name(material=setAsset_4)
watch_8 = Watch(name_4)

# group: Create material: Steel (S275)
code_block_12 = CodeBlock { "_Steel S275"; }
create_7 = Orchid.Revit.Materials.Material.Create(name=code_block_12)
material_aspect_5 = MaterialAspectDD(index=0)  # graph input
physical_type_3 = PhysicalTypeDD(index=2)  # graph input
boolean_5 = BoolSelector(true)  # graph input
create_8 = Orchid.Revit.Materials.PhysicalAsset.Create(name=code_block_12, type=physical_type_3, uniqueName=boolean_5)
code_block_13 = CodeBlock { "Steel, S275 (EN 10025-2)"; "1.0044,structural,metal,CC:EN 10025"; "thermal,solid"; "Orchid generated"; }
setInformation_5 = Orchid.Revit.Materials.PhysicalAsset.SetInformation(physicalAsset=create_8, description=code_block_13.out0, keywords=code_block_13.out1, source=code_block_13.out3)
asset_behavior_3 = AssetBehaviorDD(index=0)  # graph input
setBehavior_2 = Orchid.Revit.Materials.PhysicalAsset.SetBehavior(physicalAsset=setInformation_5, behavior=asset_behavior_3)
code_block_14 = CodeBlock { 0.00001; }
setBasicThermal_4 = Orchid.Revit.Materials.PhysicalAsset.SetBasicThermal(physicalAsset=setBehavior_2, expansionCoefficient=code_block_14)
code_block_15 = CodeBlock { 205000; 0.3; 80000; 7850; }
setMechanical_3 = Orchid.Revit.Materials.PhysicalAsset.SetMechanical(physicalAsset=setBasicThermal_4, youngModulus=code_block_15.out0, poissonRatio=code_block_15.out1, shearModulus=code_block_15.out2, density=code_block_15.out3)
code_block_16 = CodeBlock { 275; 430; }
boolean_6 = BoolSelector(true)  # graph input
setStrength = Orchid.Revit.Materials.PhysicalAsset.SetStrength(physicalAsset=setMechanical_3, yieldStress=code_block_16.out0, tensileStrength=code_block_16.out1, thermalTreated=boolean_6)
propertySet_5 = Orchid.Revit.Materials.PhysicalAsset.PropertySet(physicalAsset=setStrength)
setAsset_5 = Orchid.Revit.Materials.Material.SetAsset(material=create_7, aspect=material_aspect_5, propertySet=propertySet_5)
name_5 = Material.Name(material=setAsset_5)
watch_9 = Watch(name_5)
watch_10 = Watch(setAsset_5)
material_aspect_6 = MaterialAspectDD(index=1)  # graph input
thermal_type_3 = ThermalTypeDD(index=2)  # graph input
create_9 = Orchid.Revit.Materials.ThermalAsset.Create(name=code_block_12, type=thermal_type_3, uniqueName=boolean_5)
setInformation_6 = Orchid.Revit.Materials.ThermalAsset.SetInformation(thermalAsset=create_9, description=code_block_13.out0, keywords=code_block_13.out2, source=code_block_13.out3)
boolean_7 = BoolSelector(false)  # graph input
asset_behavior_4 = AssetBehaviorDD(index=0)  # graph input
code_block_17 = CodeBlock { 45; 0.48; 7850; 0.4; 0; 0.01; 0; 0; }
setProperties_2 = Orchid.Revit.Materials.ThermalAsset.SetProperties(thermalAsset=setInformation_6, transmitsLight=boolean_7, behavior=asset_behavior_4, thermalConductivity=code_block_17.out0, specificHeat=code_block_17.out1, density=code_block_17.out2, emissivity=code_block_17.out3, permeability=code_block_17.out4, porosity=code_block_17.out5, reflectivity=code_block_17.out6, electricalResistivity=code_block_17.out7)
propertySet_6 = Orchid.Revit.Materials.ThermalAsset.PropertySet(thermalAsset=setProperties_2)
setAsset_6 = Orchid.Revit.Materials.Material.SetAsset(material=create_7, aspect=material_aspect_6, propertySet=propertySet_6)
name_6 = Material.Name(material=setAsset_6)
watch_11 = Watch(name_6)
watch_12 = Watch(setAsset_6)

# group: Create material: Timber (C24)
code_block_18 = CodeBlock { "_Timber C24"; }
create_10 = Orchid.Revit.Materials.Material.Create(name=code_block_18)
material_aspect_7 = MaterialAspectDD(index=0)  # graph input
physical_type_4 = PhysicalTypeDD(index=3)  # graph input
boolean_8 = BoolSelector(true)  # graph input
create_11 = Orchid.Revit.Materials.PhysicalAsset.Create(name=code_block_18, type=physical_type_4, uniqueName=boolean_8)
code_block_19 = CodeBlock { "Steel, S275 (EN 10025-2)"; "1.0044,structural,metal,CC:EN 10025"; "thermal,solid"; "Orchid generated"; }
setInformation_7 = Orchid.Revit.Materials.PhysicalAsset.SetInformation(physicalAsset=create_11, description=code_block_19.out0, keywords=code_block_19.out1, source=code_block_19.out3)
asset_behavior_5 = AssetBehaviorDD(index=1)  # graph input
setBehavior_3 = Orchid.Revit.Materials.PhysicalAsset.SetBehavior(physicalAsset=setInformation_7, behavior=asset_behavior_5)
code_block_20 = CodeBlock { 0.00004; }
setBasicThermal_5 = Orchid.Revit.Materials.PhysicalAsset.SetBasicThermal(physicalAsset=setBehavior_3, expansionCoefficient=code_block_20)
code_block_21 = CodeBlock { 11000; 0.38; 690; 420; }
setMechanical_4 = Orchid.Revit.Materials.PhysicalAsset.SetMechanical(physicalAsset=setBasicThermal_5, youngModulus=code_block_21.out0, poissonRatio=code_block_21.out1, shearModulus=code_block_21.out2, density=code_block_21.out3)
code_block_22 = CodeBlock { "Multiple"; "C24"; 24; 21; 2.5; }
setStrength_2 = Orchid.Revit.Materials.PhysicalAsset.SetStrength(physicalAsset=setMechanical_4, species=code_block_22.out0, grade=code_block_22.out1, bending=code_block_22.out2, parallelCompression=code_block_22.out3, perpendicularCompression=code_block_22.out4)
propertySet_7 = Orchid.Revit.Materials.PhysicalAsset.PropertySet(physicalAsset=setStrength_2)
setAsset_7 = Orchid.Revit.Materials.Material.SetAsset(material=create_10, aspect=material_aspect_7, propertySet=propertySet_7)
name_7 = Material.Name(material=setAsset_7)
watch_13 = Watch(name_7)
watch_14 = Watch(setAsset_7)
material_aspect_8 = MaterialAspectDD(index=1)  # graph input
thermal_type_4 = ThermalTypeDD(index=2)  # graph input
create_12 = Orchid.Revit.Materials.ThermalAsset.Create(name=code_block_18, type=thermal_type_4, uniqueName=boolean_8)
setInformation_8 = Orchid.Revit.Materials.ThermalAsset.SetInformation(thermalAsset=create_12, description=code_block_19.out0, keywords=code_block_19.out2, source=code_block_19.out3)
boolean_9 = BoolSelector(false)  # graph input
asset_behavior_6 = AssetBehaviorDD(index=0)  # graph input
code_block_23 = CodeBlock { 0.12; 0.19; 496; 0.85; 0; 0.01; 0; 10000000; }
setProperties_3 = Orchid.Revit.Materials.ThermalAsset.SetProperties(thermalAsset=setInformation_8, transmitsLight=boolean_9, behavior=asset_behavior_6, thermalConductivity=code_block_23.out0, specificHeat=code_block_23.out1, density=code_block_23.out2, emissivity=code_block_23.out3, permeability=code_block_23.out4, porosity=code_block_23.out5, reflectivity=code_block_23.out6, electricalResistivity=code_block_23.out7)
propertySet_8 = Orchid.Revit.Materials.ThermalAsset.PropertySet(thermalAsset=setProperties_3)
setAsset_8 = Orchid.Revit.Materials.Material.SetAsset(material=create_10, aspect=material_aspect_8, propertySet=propertySet_8)
name_8 = Material.Name(material=setAsset_8)
watch_15 = Watch(name_8)
watch_16 = Watch(setAsset_8)
